# Grasshopper definition Rail2.gh (Grasshopper 1.0.7)

c_script = CSharpScript(x=Slider(8, range=0..20), angle="37")  # -> out, A, B, C; inputs x: Double, y: Double, angle: Double
# ---------- c_script: C# ----------
    B = Grid();

    dispc.Add(Rail1(37, 10));
    dispc.Add(Rail1(30, 10));
    dispc.Add(Rail1(20, 10));
    dispc.Add(Rail1(10, 10));
    A = dispc;
# ---------- c_script: C# additional code ----------
  public double volume = 1 / 35.0;
  public double dt = 1.0 / 60.0;
  List<Curve> dispc = new List<Curve>();
  public Curve Rail1(double x, double time){
    List<Point3d> ps = new List<Point3d>();
    Vector3d v0 = new Vector3d(60.8, 0, 0);
    v0.Rotate(x * Math.PI / 180, Vector3d.ZAxis);
    Point3d p0 = new Point3d(0, 0, 0);
    ps.Add(p0);
    for(double i = 0;i <= time;i += dt){
      double speed = v0.Length;
      double drag = speed * speed * volume * 0.2;
      Vector3d v1 = new Vector3d(v0); v1.Unitize(); v1 *= -drag;
      Vector3d v2 = new Vector3d(0, -9.82 * (1 - volume * 10.0), 0);
      p0 = p0 + v0 * dt + (v1 + v2) * dt * dt / 2.0;
      v0 = v0 + (v1 + v2) * dt;
      ps.Add(p0);
      //Print(v1.ToString());
    }
    return Curve.CreateInterpolatedCurve(ps, 1);
  }
  public Curve Rail1(double x){
    return  Rail1(x, 10);
  }

  List < string > RegEx(){
    List < string > strs = new  List<string>();
    for(int i = -15;i <= 45;i++) {
      strs.Add("^(");
    }
    for(int i = 0;i <= 20;i++){
      for(int j = -10;j <= 10;j++){
        double t = SolveAngle(new Point3d(i, j, 0));
        if(t == double.NaN)continue;
        int index = (int) Math.Round(t) + 15;
        if(index > 60 || index < 0)continue;
        string str = strs[index];
        if( str != "^(") str += "|";
        str += (i * 10 + j + 10).ToString();
        strs[index] = str;
      }
    }
    for(int i = -15;i <= 45;i++) {
      string str = strs[i + 15];
      str += ")$";
      strs[i + 15] = str;
    }
    return strs;
  }
  public double SolveAngle(Point3d des){
    for(double i = -15;i <= 65;i += 0.1){
      Curve r1 = Rail1(i);
      double t;
      r1.ClosestPoint(des, out t);
      Point3d pt = r1.PointAt(t);
      if(pt.DistanceTo(des) < 0.1){
        return i;
      }
    }
    return double.NaN;
  }

  public List<Line> Grid(){
    List<Line> output = new List<Line>();
    for(int i = 0;i <= 20;i++){
      output.Add(new Line(new Point3d(i * 10, -100, 0),
        new Point3d(i * 10, 100, 0)));

      output.Add(new Line(new Point3d(0, i * 10 - 100, 0),
        new Point3d(200, i * 10 - 100, 0)));
    }
    return output;
  }


  //Draw all wires and points in this method.
  public override void DrawViewportWires(IGH_PreviewArgs args)
  {
    for(int i = 0;i < dispc.Count;i++){
      args.Display.DrawCurve(dispc[i], System.Drawing.Color.Blue, 4);
    }
  }
# ---------- end c_script ----------
material = CreateMaterial(Diffuse=RGB(0, 0, 0), Specular=RGB(0, 0, 0), Emission=RGB(0, 0, 0), Transparency=0, Shine=0)
python = GhPythonScript()  # -> a; disabled
# ---------- python: Python ----------
from ghpythonlib.componentbase import executingcomponent as component
import Grasshopper, GhPython
import System
import Rhino
import rhinoscriptsyntax as rs

class MyComponent(component):
    def RunScript(self, x, y):
        a=[]
        for i in range(-15,38):
                a.Add(Rail2(i))
        return a
        
def Rail2(x):
    ps=[]
    volume = 1.0 / 30.0
    dt = 0.1
    ang = x * System.Math.PI / 180.0
    Vx = 80 * System.Math.Cos(ang)
    Vy = 80 * System.Math.Sin(ang)
    if(System.Math.Cos(ang)!=0):
        dragX = -Vx * Vx * volume * 0.1 / System.Math.Cos(ang)
    else:
        dragX = 0
    if(System.Math.Sin(ang)!=0):
        dragY = -System.Math.Abs(Vy / System.Math.Sin(ang)) * Vy * volume * 0.1 - 9.80665 * volume * 10.0
    else:
        dragY=- 9.80665 * volume * 10.0
    Vx = Vx + dragX * dt
    Vy = Vy + dragY * dt
    ang = -System.Math.PI / 2;
    if(Vx != 0):
        ang = System.Math.Atan(Vy / Vx)
    Vx = 64 * 0.95 * System.Math.Cos(ang)
    Vy = 64 * 0.95 * System.Math.Sin(ang)
    Sx = Vx * dt / 2.0
    Sy = Vy * dt / 2.0
    p0 = Rhino.Geometry.Point3d(Sx, Sy, 0)
    ps.Add(p0)
    for i in range(0,199):
        if(System.Math.Cos(ang)!=0):
            dragX = -Vx * Vx * volume * 0.1 / System.Math.Cos(ang)
        else:
            dragX = 0
        if(System.Math.Sin(ang)!=0):
            dragY = -System.Math.Abs(Vy / System.Math.Sin(ang)) * Vy * volume * 0.1 - 9.80665 * volume * 10.0
        else:
            dragY=- 9.80665 * volume * 10.0
        Vx = Vx + dragX * dt
        Vy = Vy + dragY * dt
        ang = -System.Math.PI / 2;
        if(Vx != 0):
            ang = System.Math.Atan(Vy / Vx)
        Sx = p0.X + Vx * dt / 2.0
        Sy = p0.Y + Vy * dt / 2.0
        p0 = Rhino.Geometry.Point3d(Sx, Sy, 0)
        ps.Add(p0)
    return Rhino.Geometry.Curve.CreateInterpolatedCurve(ps, 1)
# ---------- end python ----------
preview = CustomPreview(Geometry=c_script.B, Material=material)
ccx = CurveCurve(CurveA=c_script.A, CurveB=<geometry referenced from the Rhino model>)  # -> Points, ParamsA, ParamsB
panel = Panel(c_script.out)
