# Grasshopper definition Rail3.gh (Grasshopper 1.0.7)

c_script = CSharpScript(angle=Slider(37, range=0..90), time=Slider(10, range=0..20), x=Slider(0.6293, range=0..2), y=Slider(1.0369, range=0..2))  # -> out, A, B, C, D, E, F; inputs angle: Double, time: Double, x: Double, y: Double
# ---------- c_script: C# ----------
    List<Polyline> pls = new List<Polyline>();
    for(int i = 0;i < 89;i++){
      Polyline outa = Rail2(0 + i, 7, t1, t2);
      pls.Add(outa);
    }
    A = pls;
    // C = intersect(outa, new Line(new Point3d(0, -0.1, 0), new Point3d(1200, -0.1, 0)));
# ---------- c_script: C# additional code ----------
  double t1 = 0.6293;
  double t2 = 1.0369;
  public Point3d intersect(Polyline pl, Line l){
    PolylineCurve pll = pl.ToPolylineCurve();
    return  Rhino.Geometry.Intersect.Intersection.CurveLine(pll, l, 0.001, 0.001)[0].PointA;
  }
  public double   total(){

    Line l1 = new Line(new Point3d(0, -10, 0), new Point3d(1200, -10, 0));
    Line l2 = new Line(new Point3d(0, -20, 0), new Point3d(1200, -20, 0));
    Line l3 = new Line(new Point3d(0, -30, 0), new Point3d(1200, -30, 0));
    Line l4 = new Line(new Point3d(0, -50, 0), new Point3d(1200, -50, 0));
    Polyline pl1 = Rail2(0, 10, t1, t2);
    Line l5 = new Line(new Point3d(0, -0.1, 0), new Point3d(1200, -0.1, 0));
    Polyline pl2 = Rail2(33, 10, t1, t2);//190
    Polyline pl3 = Rail2(22, 10, t1, t2);//174
    Point3d p1,p2,p3,p4,p5,p6;
    p1 = new  Point3d(); p2 = new  Point3d(); p3 = new  Point3d();
    p4 = new  Point3d(); p5 = new  Point3d(); p6 = new  Point3d();
    return Math.Pow(p1.X - 89, 2) + Math.Pow(p2.X - 120, 2) + Math.Pow(p3.X - 138, 2) + Math.Pow(p4.X - 165, 2)
      + Math.Pow(p5.X - 190, 2) + Math.Pow(p6.X - 174, 2);
  }

  public Polyline Rail1(double angle, double time){
    double volume = Mass / Density;
    Vector3d frontVel = new Vector3d(maxVelocity * 0.95, 0, 0);
    Point3d localFront = new Point3d(0, 0, 0);
    Polyline ps = new Polyline();
    ps.Add(localFront);
    frontVel.Transform(Transform.Rotation(angle / 180.0 * Math.PI, Vector3d.ZAxis, localFront));
    for(double i = 0;i < time;i += dt){
      double speed = frontVel.Length;
      double drag = speed * speed * WaterDragCoefficient * volume * NeutralDensity;
      drag *= 9.82 * 0.02;
      Vector3d dragVec = new Vector3d(frontVel);
      dragVec.Unitize();
      dragVec *= -drag;
      Vector3d buoyancy = -Gravity * forceFactor * volume * NeutralDensity;
      localFront = localFront + frontVel * dt + (dragVec + buoyancy + Gravity ) / 2 * dt * dt;
      frontVel = frontVel + (dragVec + buoyancy + Gravity  ) * dt;
      ps.Add(localFront);
    }
    return ps;
  }


  public Polyline Rail2(double angle, double time, double t1, double  t2){
    Vector3d frontVel = new Vector3d(80, 0, 0);
    Point3d localFront = new Point3d(0, 0, 0);
    Polyline ps = new Polyline();
    ps.Add(localFront);
    frontVel.Transform(Transform.Rotation(angle / 180.0 * Math.PI, Vector3d.ZAxis, localFront));
    for(double i = 0;i < time;i += dt){
      double speed = frontVel.Length;
      double drag = speed * speed * 0.01;
      Vector3d dragVec = new Vector3d(frontVel);
      dragVec.Unitize();
      dragVec *= -drag;
      Vector3d a = dragVec * t1 + Gravity * t2;
      localFront = localFront + frontVel * dt + a * dt * dt / 2;
      frontVel = frontVel + a * dt;
      ps.Add(localFront);
    }
    return ps;
  }
  public  double WaterDragCoefficient = 0.1;
  public  double forceFactor = 1.0;
  public  double maxVelocity = 64.0;
  public  Vector3d Gravity = new Vector3d(0, -9.82, 0);
  public  double Density = 35,Mass = 1,Width = 2.15,Height = 0.30;
  public  double dt = 1.0 / 60.0;
  public  double NeutralDensity = 10.0;
# ---------- end c_script ----------
panel = Panel(c_script.C)
